# Grasshopper definition SIDD 보를 위해 조정.gh (Grasshopper 1.0.7)
# plug-ins: Pufferfish

crv = Curve([<curve referenced from the Rhino model> x97])
debrep = DeconstructBrep(Brep=crv)  # -> Faces, Edges, Vertices
len = Length(Curve=debrep.Edges)
sort = SortList(Keys=len)  # -> Keys, ValuesA
evalsrf = EvaluateSurface(Surface=debrep.Faces, Point="0.5, 0.5")  # -> Point, Normal, UDirection, VDirection, Frame
round = Round(Number=sort.Keys)  # -> Nearest, Floor, Ceiling
item = ListItem(List=round.Nearest, Index="0", Wrap=True)  # -> flatten(Item)
paramptonsrf = ParameterPointOnSurface(Surface=debrep.Faces, ParameterU="0.5", ParameterV="0.5")  # -> Point, Normal
panel = Panel(item)
text_join = CSharpScript(x="헛보", y=panel)  # -> out, graft(A); inputs x: String, y: list of String
# ---------- text_join: C# ----------
    List<string> wallWidth = new List<string>();

    for(int i = 0; i < y.Count ; i++)
    {


      wallWidth.Add(x + y[i]);
      A = wallWidth;
    }
# ---------- end text_join ----------
tag = TextTag3D(Location=paramptonsrf.Point, Text=text_join.A, Size="200", Justification=7)
panel_2 = Panel(text_join.A)
